# Grasshopper definition Princeton_SoA-DualTrack_SimpleMovementExample.gh (Grasshopper 0.9.76)
# plug-ins: Robots

# ---- group: Divide a curve to make some target positions
crv = Curve(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)
divide = DivideCurve(Curve=crv, Count="20", Kinks=False)  # -> Points, Tangents, Parameters

crv_2 = Curve(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)
divide_2 = DivideCurve(Curve=crv_2, Count="20", Kinks=False)  # -> Points, Tangents, Parameters

# ---- group: Make Planes Pointing in Negative Y for Robot #1
Y = UnitY(Factor="-1")
pl = PlaneNormal(Origin=divide.Points, ZAxis=Y)

# ---- group: Make Planes Pointing in Positive Y for Robot #2
Y_2 = UnitY(Factor="1")
pl_2 = PlaneNormal(Origin=divide_2.Points, ZAxis=Y_2)

# ----
# ROBOT #1
robot_1_target_planes = Plane(pl)

# ----
# ROBOT #2
robot_2_target_planes = Plane(pl_2)

# ---- group: Get R1 External Axis Position
# If You will frequently be using tracks, consider adding this cluster as a "Util" object to Robots by going to "File>Create User Object"
r1_expos = Robot1TrackPosition(plane=robot_1_target_planes)

# ---- group: Get R2 External Axis Position
# If You will frequently be using tracks, consider adding this cluster as a "Util" object to Robots by going to "File>Create User Object"
r2_expos = Robot2TrackPosition(plane=robot_2_target_planes)

# ---- group: Load Our Robots
list = ValueList({"Bartlett-IRB120", "Bartlett-IRB1600", "Bartlett-KR6", "Bartlett-KR60", "Bartlett-UR10", "ETH-Gantry", "SoA-IRB7600", "SoA-IRB120", "SoA-IRB4600", "SoA-UR3", "SoA-IRB7600", "SoA-IRB120", "SoA-IRB4600", "SoA-UR3", "Generic-UR3", "Generic-UR5", "Generic-UR10"}, selected="SoA-IRB4600")
load_robot = LoadRobotSystem(Name=list, Base=PlaneXY(0, 0, 0))

# ---- group: Create a Tool (We'll use the same for both robots)
tool_tip_pt = Point(Point(0, 0, 117.0956147))
center_of_mass_optional = Point(Point(0, 0, 29.27390368))
weight_kg = Panel(".5")
# Basic Princeton SoA Dual Track Example: For "Robots" Plugin {https://github.com/visose}
# For questions on Princeton's track setup, email Ryan Luke Johns{ryan@greyshed.com}
tool_name = Panel("CONE")
tool_mesh = Mesh(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)

# ---- group: Create a Tool (We'll use the same for both robots) / Tool Orientation
xy = XYPlane(Origin=tool_tip_pt)

# ---- group: Create a Tool (We'll use the same for both robots) (continued)
tool = CreateTool(Name=tool_name, TCP=xy, Weight=weight_kg, Centroid=center_of_mass_optional, Mesh=tool_mesh)  # -> Tool, TCP

# ---- group: Create Motion Targets for Robot #1 (South)
speed = Panel("200")
zone = Panel("1")
list_2 = ValueList({"Joint", "Linear"}, selected="Linear")
target = CreateTarget(Plane=robot_1_target_planes, Motion=list_2, Tool=tool.Tool, Speed=speed, Zone=zone, External=r1_expos, IsCartesian=True)

# ---- group: Create Motion Targets for Robot #2 (North)
zone_2 = Panel("1")
speed_2 = Panel("200")
list_3 = ValueList({"Joint", "Linear"}, selected="Linear")
target_2 = CreateTarget(
    Plane=robot_2_target_planes,
    Motion=list_3,
    Tool=tool.Tool,
    Speed=speed_2,
    Zone=zone_2,
    External=r2_expos,
    IsCartesian=True)  # -> flatten(Target)

# ---- group: Generate Robot Programs
program = CreateProgram(Name="RLJ_Ex1", RobotSystem=load_robot, Targets1=target, Targets2=target_2, StepSize=1)  # -> Program, simplify(Code), Duration, Warnings, Errors

# ---- group: Simulate Robot Motion - Right Click to Open Controls
sim = ProgramSimulation(Program=program.Program, Time=Slider(0.338, range=0..1), Normalized=True)  # -> SystemMeshes, JointRotations, Plane, Index, Time, Program, Errors

# ---- group: Robot # 1 Code
branch = TreeBranch(Tree=program.Code, Path=["{0;0}", "{0;1}"], MaintainPaths=True)  # -> flatten(Branch)

# ---- group: Robot # 2 Code
branch_2 = TreeBranch(Tree=program.Code, Path=["{1;0}", "{1;1}"], MaintainPaths=True)  # -> flatten(Branch)

# ----
robot_2_program = Panel(branch_2)
# Right click robot program and set a stream destination to your desired location, and specify type as any (not only .txt).  Save files as .prg, .mod or .pgf
# 
# Hit and unhit "stream contents" and upload over USB
# (Or use "Remote" component to connect and use auto uploader over ethernet)
robot_1_program = Panel(branch)
warnings = Panel(program.Warnings)
errors = Panel(program.Errors)

# ==== cluster Robot2TrackPosition: Gets the position of the external axis for robot 2 (base is same as world origin), given a plane as an input.
# Robot 2 Is aligned with the world base plane at Princeton
plane = ClusterInput()  # Input plane to align track with

# ---- group: Get X Value of Plane Position
deplane = DeconstructPlane(Plane=plane)  # -> Origin, XAxis, YAxis, ZAxis
pdecon = Deconstruct(Point=deplane.Origin)  # -> XComponent, YComponent, ZComponent

# ---- group: Constrain positions to within the range of the track
min_track_value = Panel("0")
max_track_value = Panel("3900")
dom = ConstructDomain(DomainStart=min_track_value, DomainEnd=max_track_value)
constrain = Constrain(Number=pdecon.XComponent, Domain=dom)

# ----
external_axis_position = ClusterOutput(constrain)  # Gets the track-length-bounded (0-3900 mm) poisition of the track corresponding to the x-value of an input plane.

# ==== cluster Robot1TrackPosition: Gets the position of the external axis for robot 1 (base is different world origin), given a plane as an input. Basically, converts the input plane to the coordinate system of track #1, and returns the x value of the plane, as bounded between 0 and 3900 mm.
plane = ClusterInput()  # Input plane to align track with

# ---- group: Convert Plane positions from BASE to coordinate system of Robot 1 Track
robot_1_base_plane = Plane(Plane(origin=(3695.65, 3451.77, 23.1866), x=(-0.9999959743, -0.0007561824549, -0.002734894202), y=(0.0007632270035, -0.9999963917, -0.002575677202)))
xy = XYPlane(Origin=Point(0, 0, 0))
orient = Orient(Geometry=plane, Source=robot_1_base_plane, Target=xy)  # -> Geometry, Transform
pdecon = Deconstruct(Point=orient.Geometry)  # -> XComponent, YComponent, ZComponent

# ---- group: Constrain positions to within the range of the track
min_track_value = Panel("0")
max_track_value = Panel("3900")
dom = ConstructDomain(DomainStart=min_track_value, DomainEnd=max_track_value)
constrain = Constrain(Number=pdecon.XComponent, Domain=dom)

# ----
external_axis_position = ClusterOutput(constrain)  # Gets the track-length-bounded (0-3900 mm) poisition of the track corresponding to the x-value of an input plane.
