# Grasshopper definition UR3-SimpleMovement-Example.gh (Grasshopper 0.9.76)
# plug-ins: Robots

# ---- group: Create Target Planes
# Robot targets are made of "Frames" or "Planes"
# (whatever you want to call them). Which are made up of a
# position, and an orientation.  We can define this in many ways,
# but eventually we need to get a list of target planes as GH "plane"
# objects!
# 
# In this example, we start with a curve, and take points at an even interval along it.
# Then, we make points at those planes with the z vector pointing striaght down
# (because we want our tool to point down).
curve_to_follow = Curve(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)
divdist = DivideDistance(Curve=curve_to_follow, Distance="10")  # -> Points, Tangents, Parameters
Z = UnitZ(Factor="-1")
pl = PlaneNormal(Origin=divdist.Points, ZAxis=Z)

# ---- group: Define Your Tool
tcp = Panel("{0,0,30}")
tool_name = Panel("cone")
xy = XYPlane(Origin=Point(0, 0, 0))
xy_2 = XYPlane(Origin=tcp)
cone = Cone(Base=xy, Radius="30", Length="30")  # -> Cone, Tip
mesh = Mesh(cone.Cone)
tool = CreateTool(Name=tool_name, TCP=xy_2, Weight=0, Mesh=mesh)  # -> Tool, TCP

# ---- group: Here We Load our Robot Model
list = ValueList({"Generic-UR3", "Generic-UR5", "Generic-UR10"}, selected="Generic-UR3")
load_robot = LoadRobotSystem(Name=list, Base=PlaneXY(0, 0, 0))

# ----
list_2 = ValueList({"Bartlett-IRB120", "Bartlett-IRB1600", "Bartlett-KR6", "Bartlett-KR60", "Bartlett-UR10", "ETH-Gantry", "SoA-IRB7600", "SoA-IRB120", "SoA-IRB4600", "SoA-UR3", "Generic-UR3", "Generic-UR5", "Generic-UR10"}, selected="Generic-UR3")

# ---- group: Input the Planes You want the robot to drive through here
pln = Plane(pl)

# ----
load_robot_2 = LoadRobotSystem(Name=list_2, Base=PlaneXY(0, 0, 0))

# ---- group: Create Robot Target Frames For Motion
# Here, we convert those planes to moveL
# commands by also providing a speed and
# blend radius.
zone_size_blending = Panel("2.0")
speed_mm_sec = Panel("50")
list_3 = ValueList({"Joint", "Linear"}, selected="Linear")
target = CreateTarget(Plane=pln, Motion=list_3, Tool=tool.Tool, Speed=speed_mm_sec, Zone=zone_size_blending, IsCartesian=True)

# ---- group: Generate The Robot Program
program_name = Panel("simpleMove")
program = CreateProgram(Name=program_name, RobotSystem=load_robot_2, Targets1=target, StepSize=1)  # -> Program, Code, Duration, Warnings, Errors

# ---- group: Upload To Robot
# This is your control panel for sending files to the robot.
# Press the buttons as necessary.  Upload first.
# Use play or stop as necessary, or stop on the robot controller
# in case of emergency.
robot_ip_address = Panel("169.254.0.0")
upload_program = Button()
stop = Button()
play = Button()
remote = RemoteConnection(Program=program.Program, IP=robot_ip_address, Upload=upload_program, Play=play, Pause=stop)
log = Panel(remote)

# ---- group: Messages
duration_sec = Panel(program.Duration)
warnings = Panel(program.Warnings)
errors = Panel(program.Errors)

# ---- group: Simulate Our Robot Motion For Preview
# Simulation!  Slide through the slider to animate.
# Or, right click on the sim component and open the
#  control panel and press play!
number_slider = Slider(0, range=0..1)
sim = ProgramSimulation(Program=program.Program, Time=number_slider, Normalized=True)  # -> SystemMeshes, JointRotations, Plane, Index, Time, Program, Errors
trail = SimpleTrail(Program=sim.Program, Length=500, MechanicalGroup=0)
time = Panel(sim.Time)

# ----
this_is_your_final_robot_code_have_a_loo = Panel(program.Code)  # "This is your final robot code. Have a look over it to make sure it seems ok."
